test file "InitialTrajectoryChangesModel"

suite "Testing V,R"

  case "New Test Case 1" [baseline]
    model MPC3DoF
    iteration script:
      % For my own personal list:

      % v1, v2, r1, r2, r1, r2, (w is ang velocity?)
      %% Iterating through initial position and velocity.

      rng("default")
      %changes
      v1 = 0:10:50;
      v2 = randi(100,1,1); % Random # between 0 and 100 - might change to 50, etc.


      r1 = 0:0.1:0.5;
      r2 = rand *0.5;

      % may include v3, r3.


      %% Iterate over controller types
      controller_types = [ControllerType.CasADi, ...
                          ControllerType.CasADi_freetf, ...
                          ControllerType.CasADi_delay, ...
                          ControllerType.CasADi_freetf_delay];

      % Create each iteration
      for c = 1 : numel(controller_types)
          for v_1 = 1:numel(v1)
              % Set up a new iteration object
              testItr = sltestiteration();
              v_2 = v2;
              setVariable(testItr,'Name','controller_type','Source','model workspace', 'Value', controller_types(c));
              setVariable(testItr,'Name','v1','Source','model workspace', 'Value', v1(v_1));
              setVariable(testItr,'Name','v2','Source','model workspace', 'Value', v_2);

              % Register the iteration to run in this test case
              addIteration(sltest_testCase, testItr, sprintf("Delay_%.3f %s", delay(d), controller_types(c)));
          end
      end

suite "Testing Angle, W"

  case "New Test Case 1" [baseline]